# Grasshopper definition Load_ontology.gh (Grasshopper 1.0.7)
# plug-ins: Hops

# https://www.projekt-scope.de/ontologies/omg/omg.ttl
panel = Panel("http://www.w3id.org/bot/bot.ttl")
hops = Hops(
    _Path="http://127.0.0.1:5000/loadOntology",
    URL=panel,
    CacheResultsInMemory=False,
    CacheSolveResults=False,
    RemoteDefinitionLocation="http://127.0.0.1:5000/loadOntology",
    RemoteSolveVersion=(0, 1, 0),
    ShowInput_Enabled=False,
    ShowInput_Path=True,
    SynchronousSolve=True)  # -> Classes, Properties, Individuals
panel_2 = Panel(hops.Classes)
panel_3 = Panel(hops.Properties)
panel_4 = Panel(hops.Individuals)
