# Grasshopper definition test_01.gh (Grasshopper 1.0.7)
# plug-ins: Hops

# http://www.w3id.org/bot/bot.ttl
panel = Panel("https://www.projekt-scope.de/ontologies/omg/omg.ttl")
hops = Hops(
    _Path="http://127.0.0.1:5000/loadOntology",
    URL=panel,
    CacheResultsInMemory=False,
    CacheSolveResults=False,
    RemoteDefinitionLocation="http://127.0.0.1:5000/loadOntology",
    RemoteSolveVersion=(0, 1, 0),
    ShowInput_Enabled=False,
    ShowInput_Path=True,
    SynchronousSolve=True)  # -> Out, Bool
panel_2 = Panel(hops.Out)
